# Grasshopper definition theater_sightlines.gh (Grasshopper 1.0.7)

# scale => 1:1
# - standard of measurement  : floor to head
# - sitting_height : 1260mm
# - sitting_sight_level : 1148mm
# - seat_depth : 500mm
number_slider = Slider(8.5, range=7..10)
number_slider_2 = Slider(4.1, range=3..5)
point = Point([Point(0, -2.5, 7.943933452), Point(-0.5003125752, -2.5, 7.943933452), Point(-0.5003125752, -2.5, 4.999638125), Point(-5, -2.5, 4.999638125), Point(-5, -2.5, 4.499638125), Point(-4.5, -2.5, 4.499638125), Point(-4.5, -2.5, -0.0003618753641), Point(-4, -2.5, -0.0003618753641), Point(-4, -2.5, 4.499638125), Point(-0.5, -2.5, 4.499638125), Point(-0.5, -2.5, -0.0003618753641), Point(0, -2.5, -0.0003618753641), Point(0, -2.5, 7.943933452)])
point_2 = Point([Point(307.3443937, 30.81644905, 119.1163868), Point(69.05908887, 30.81644905, 119.1163868), Point(69.05908887, 30.81644905, -50.15866179), Point(307.3443937, 30.81644905, -50.15866179), Point(307.3443937, 30.81644905, 119.1163868)])
# scale => 1:100
# standard of measurement : floor to head
# - sitting_height : 12.6
# - sitting_sight_level : 11.5
# - seat_depth : 5
ghpython_script = GhPythonScript(step_width=number_slider, step_height=number_slider_2, chair_pts=point, cutter_pts=point_2)  # -> out, auditorium_brep, auditorium_chairs, auditorium_height, auditorium_section; inputs chair_pts: list of Point3d, cutter_pts: list of Point3d
# ---------- ghpython_script: Python ----------
import math
import random
import Rhino.Geometry as rg
import Rhino.RhinoDoc as rc
import rhinoscriptsyntax as rs
import ghpythonlib.components as gh


class Point:
    def __init__(self, x, y, z):
        self.x = x
        self.y = y
        self.z = z
        self.coordinate = self.get_coordinate()
        
    def get_coordinate(self):
        return [self.x, self.y, self.z]
        
    def generate_point(self):
        x, y, z = self.coordinate
        point = rs.AddPoint(x,y,z)
        return rs.PointCoordinates(point)
        
        
class Curve:
    def __init__(self, points):
        self.DEGREE = 1
        self.DISTANCE = 5
        self.DIRECTION = [0, 0, 0]
        self.points = points
        self.curve = self.generate_curve()
        
    def generate_curve(self):
        return rs.AddCurve(self.points, self.DEGREE)
        
    def offset_curve(self):
        return rs.OffsetCurve(self.curve, self.DIRECTION, self.DISTANCE)[0]
        
        
class Surface:
    def __init__(self, crvs):
        self.crvs = crvs
        self.srf = self.generate_surface()
        
    def generate_surface(self):
        return rs.AddPlanarSrf(self.crvs)
        
    def extrude_surface(self, direction):
        return rs.ExtrudeSurface(self.srf, direction)
        
        
class Auditorium:
    def __init__(self, step_height, step_width, cutter_pts):
        self.SCALE = 100
        self.START_X = 110
        self.END_X = 270
        self.STEP_COUNT = 10
        self.STEP_X = 160
        self.STEP_Y = 0
        self.CHAIR_Y = 5
        self.CEIL_Z = 65
        self.CHAIRS = 11
        self.SECTION_M = [230, 0, 0]
        self.DIRECTION_A = self.auditorium_direction()
        self.DIRECTION_C = self.chair_direction()
        
        self.step_width = step_width
        self.step_height = step_height
        self.cutter_pts = cutter_pts
        self.base_pts = self.base_points()
        self.base_crvs = self.base_curves()
        self.auditorium = self.generate_auditorium()
        self.chairs = []
        
    def base_points(self):
        base_pts = [Point(self.START_X,0,0).generate_point()]
        mul_list = []
        for i in range(self.STEP_COUNT+1):
            mul_list.extend([i, i])
            
        for i in zip(mul_list[:-1], mul_list[1:]):
            point = Point(self.STEP_X + self.step_width * i[0],
                          self.STEP_Y,
                          self.step_height * i[1])
            base_pts.append(point.generate_point())
        base_pts[-1][0] = self.END_X
        
        ceil_pt_1 = Point(self.END_X, self.STEP_Y, self.CEIL_Z)
        ceil_pt_2 = Point(self.START_X, self.STEP_Y, self.CEIL_Z)
        base_pts.extend([ceil_pt_1.generate_point(),
                         ceil_pt_2.generate_point(),
                         base_pts[0]])
        return base_pts
        
    def base_curves(self):
        crv_1 = Curve(self.base_pts).generate_curve()
        crv_2 = Curve(self.base_pts).offset_curve()
        return crv_1, crv_2
        
    def base_surface(self):
        return Surface(self.base_crvs).generate_surface()
        
    def auditorium_direction(self):
        pt1 = Point(self.STEP_Y, self.STEP_Y, self.STEP_Y).generate_point()
        pt2 = Point(self.STEP_Y ,self.CEIL_Z ,self.STEP_Y).generate_point()
        return Curve([pt1, pt2]).generate_curve()
        
    def chair_direction(self):
        pt1 = Point(self.STEP_Y, self.STEP_Y, self.STEP_Y).generate_point()
        pt2 = Point(self.STEP_Y, self.CHAIR_Y, self.STEP_Y).generate_point()
        return Curve([pt1, pt2]).generate_curve()
        
    def generate_auditorium(self):
        return Surface(self.base_crvs).extrude_surface(self.DIRECTION_A)
        
    def elements_auditorium(self, brep):
        try:
            faces, edges, vertices = gh.DeconstructBrep(rs.coercebrep(brep))
        except:
            faces, edges, vertices = gh.DeconstructBrep(brep)
        return faces, edges, vertices
        
    def generate_chairs(self, chair_pts):
        chair_crv = Curve(chair_pts).generate_curve()
        chair_ori = Surface(chair_crv).extrude_surface(self.DIRECTION_C)
        auditorium_lines = self.elements_auditorium(self.auditorium)[1]
        lines_index = [i for i in range(106, 142, 4)]
        for i in lines_index:
            base_curve = auditorium_lines[i]
            base_points = gh.DivideCurve(base_curve, self.CHAIRS, False)[0]
            base_points.pop(0); base_points.pop(-1)
            for bp in base_points:
                chair = rs.CopyObject(chair_ori, bp)
                self.chairs.append(chair)
        return self.chairs
        
    def generate_section(self):
        cutter_crv = Curve(self.cutter_pts).generate_curve()
        cutter = Surface(cutter_crv).generate_surface()
        cutting_idx = [i for i in range(5, 95, 10)]
        section_lines = []
        for i in cutting_idx:
            split_chair = rs.SplitBrep(self.chairs[i], cutter)[1];\
                          rs.CapPlanarHoles(split_chair)
            section_chair = self.elements_auditorium(split_chair)[0][0]
            section_lines.append(section_chair)
        
        split_auditorium = rs.SplitBrep(self.auditorium, cutter)[1];\
                           rs.CapPlanarHoles(split_auditorium);
        section_auditorium = self.elements_auditorium(split_auditorium)[0][0]
        section_lines.append(section_auditorium)
        rs.MoveObjects(section_lines, self.SECTION_M)
        return section_lines
        
    def calculate_ceil_height(self):
        ceil_height = rs.Distance(self.base_pts[-3], self.base_pts[-4]) * self.SCALE
        if ceil_height < 2300:
            return 0
        else:
            return ceil_height
        
    def calculate_step_width(self):
        margin_space = (self.step_width - self.CHAIR_Y) * self.SCALE
        if margin_space < 350:
            return 0
        else:
            return margin_space
        
    def calcuate_cvalue(self):
        curr_ceil_height = self.calculate_ceil_height()
        curr_step_width = self.calculate_step_width()
        print(curr_ceil_height)
        print(curr_step_width)
        section_lines = self.generate_section()[-1]
        base_line = self.elements_auditorium(section_lines)[1][25]
        focus = rs.CurveMidPoint(base_line)
        return focus


if __name__ == "__main__":
    auditorium = Auditorium(step_height, step_width, cutter_pts)
#    auditorium_height = auditorium.calculate_ceil_height()
    auditorium_brep = auditorium.generate_auditorium()
    auditorium_chairs = auditorium.generate_chairs(chair_pts)
    auditorium_section = auditorium.generate_section()
    auditorium_focus = auditorium.calcuate_cvalue()
# ---------- end ghpython_script ----------
geometry = Geometry(ghpython_script.auditorium_chairs)
number = Number(ghpython_script.auditorium_height)
brep = Brep(ghpython_script.auditorium_section)
height = Panel(number)
galapagos = Galapagos(fitness=number, gene=[number_slider, number_slider_2])
custom_preview = CustomPreview(
    Geometry=[ghpython_script.auditorium_brep, geometry, ghpython_script.auditorium_section],
    Material=ColourSwatch(SwatchColor=RGB(194, 0, 0)))
point_3 = Point(Point(0, 0, 0))
deconstruct_brep = DeconstructBrep(Brep=ghpython_script.auditorium_section)  # -> Faces, Edges, Vertices
move = Move(Geometry=brep, Motion=point_3)  # -> Geometry, Transform
list_item = ListItem(List=flatten(brep), Index=Slider(9, range=0..9), Wrap=True)
deconstruct_brep_2 = DeconstructBrep(Brep=list_item)  # -> Faces, Edges, Vertices
list_item_2 = ListItem(List=flatten(deconstruct_brep.Vertices), Index=Slider(286, range=0..1000), Wrap=True)
deconstruct_brep_3 = DeconstructBrep(Brep=move.Geometry)  # -> Faces, Edges, Vertices
list_item_3 = ListItem(List=flatten(deconstruct_brep_2.Edges), Index=[37, 39], Wrap=True)
move_2 = Move(Geometry=list_item_2, Motion=Vector(0, 0, 10))  # -> Geometry, Transform
list_item_4 = ListItem(List=flatten(deconstruct_brep_3.Edges), Index=Slider(132, range=0..1000), Wrap=True)
unit_z = UnitZ(Factor=Slider(11.5, range=0..20))
curve_middle = CurveMiddle(Curve=list_item_3)
xz_plane = XZPlane(Origin=move_2.Geometry)
move_3 = Move(Geometry=curve_middle, Motion=unit_z)  # -> Geometry, Transform
mesh = Mesh(<mesh referenced from the Rhino model>)
text_tag_3d = TextTag3D(Location=xz_plane, Text="Calculate Visualization", Size=5, Justification=7)
evaluate_curve = EvaluateCurve(Curve=list_item_4, Parameter=Slider(0, range=0..1))  # -> Point, Tangent, Angle
line = Line(StartPoint=evaluate_curve.Point, EndPoint=move_3.Geometry)
list_item_5 = ListItem(List=move_3.Geometry, Index=0, Wrap=True)
move_4 = Move(Geometry=mesh, Motion=list_item_5)  # -> Geometry, Transform
unit_z_2 = UnitZ(Factor=1)
line_sdl = LineSDL(Start=list_item_5, Direction=unit_z_2, Length=Slider(20, range=0..100))
line_line = LineLine(Line1=line, Line2=line_sdl)  # -> ParamA, ParamB, PointA, PointB
list_item_6 = ListItem(List=line_line.PointA, Index=0, Wrap=True)
list_item_7 = ListItem(List=line_line.PointB, Index=1, Wrap=True)
distance = Distance(PointA=list_item_6, PointB=list_item_7)
multiplication = Multiplication(A="100", B=distance)
panel = Panel(multiplication)
